% Simulink data dictionary fmuGenerationDictionay.sldd

fast_tsk_conf = Simulink.ConfigSet(StartTime="0", StopTime="inf", FixedStep="fast_tsk_st", Solver="FixedStepAuto", ProdHWDeviceType="Custom Processor->Custom Processor", SystemTargetFile="fmu2cs.tlc", TargetLang="C")  % Fast task configuration for protected model and FMU generation
  % Sample frequency = 5000 Hz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

ctrl_tsk_conf = Simulink.ConfigSet(StartTime="0", StopTime="inf", FixedStep="ctrl_tsk_st", Solver="FixedStepAuto", ProdHWDeviceType="Custom Processor->Custom Processor", SystemTargetFile="fmu2cs.tlc", TargetLang="C")  % Reference configuration for protected model and FMU generation
  % Sample frequency = 3750 Hz
  % ctrl_tsk_st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

slow_tsk_conf = Simulink.ConfigSet(StartTime="0", StopTime="inf", FixedStep="slow_tsk_st", Solver="FixedStepAuto", ProdHWDeviceType="Custom Processor->Custom Processor", SystemTargetFile="fmu2cs.tlc", TargetLang="C")  % Slow task configuration for protected model and FMU generation
  % Sample frequency = 117.1875 Hz
  % ctrlTs_slow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

pwn_tsk_conf = Simulink.ConfigSet(StartTime="0", StopTime="inf", FixedStep="pwm_tsk_st", Solver="FixedStepAuto", ProdHWDeviceType="Custom Processor->Custom Processor", SystemTargetFile="fmu2cs.tlc", TargetLang="C")  % Fast task configuration for protected model and FMU generation
  % Sample frequency = 5000 Hz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

pwm_tsk_f = 15000
pwm_tsk_st = 6.667e-5
fast_tsk_f = 117.186035
fast_tsk_st = 0.00853344
ctrl_tsk_f = 3750
ctrl_tsk_st = 0.00026667
slow_tsk_f = 117.186035
slow_tsk_st = 0.00853344
Tr_nom_v = 230
Tr_max_v = 325.2691
Max_DC_limit = 400
DC_ff_max = 1000
DC_ff_min = 10

dcBusCtrl = struct(
  Sum=struct(PGain=2, IGain=10, Num=[0.9835194 -1.939493 0.9835194], Den=[1 -1.939493 0.9670389]),
  Pgain=0.5,
  IGain=5,
  Diff=struct(Num=[0.9916918 -1.976428 0.9916918], Den=[1 -1.976428 0.9833837]))

shuntMaxRequestedCurrentrms = 110
shuntHarmonicsCorrected = [3 5 7 9 11 13]
shuntNumHarmonics = 6
hpfratio = 1.1
prCurrentCtrl = struct(Fc=1.5, Kp=0.5, Kr=50, Num=[0.5 -0.9655 0.4657], Den=[1 -1.9979 0.9983], f0=50)
Trx_Ratio = 10